# Grasshopper definition XHG.⠀⠀⠀⠀ⵙ⠀ᗱᗴ⠀ⵙ⠀ᴥ⠀ⵙ⠀ᗱᗴ⠀ⵙ⠀옷⠀ⵙ⠀ߦ⠀ⵙ⠀ᔓᔕ⠀ⵙ⠀⠀◯⠀⠀ⵙ⠀ИN⠀ⵙ⠀Ⓞ⠀ⵙ⠀⠀◯⠀⠀ⵙ⠀ИN⠀ⵙ⠀Ⓞ⠀ⵙ⠀ꖴ⠀ⵙ⠀✤⠀ⵙ⠀ᑐᑕ⠀ⵙ⠀ᗱᗴ⠀ⵙ⠀ᒍᒐ⠀ⵙ⠀Ⓞ⠀ⵙ⠀ᴥ⠀ⵙ⠀ߦ⠀ⵙ⠀⠀⠀⠀◯⠀⠀⠀⠀ⵙ⠀⠀⠀⠀◯⠀⠀⠀⠀ⵙ⠀ߦ⠀ⵙ⠀ᴥ⠀ⵙ⠀Ⓞ⠀ⵙ⠀ᒍᒐ⠀ⵙ⠀ᗱᗴ⠀ⵙ⠀ᑐᑕ⠀ⵙ⠀✤⠀ⵙ⠀ꖴ⠀ⵙ⠀Ⓞ⠀ⵙ⠀ИN⠀ⵙ⠀⠀◯⠀⠀ⵙ⠀Ⓞ⠀ⵙ⠀ИN⠀ⵙ⠀⠀◯⠀⠀ⵙ⠀ᔓᔕ⠀ⵙ⠀ߦ⠀ⵙ⠀옷⠀ⵙ⠀ᗱᗴ⠀ⵙ⠀ᴥ⠀ⵙ⠀ᗱᗴ⠀ⵙ⠀⠀⠀⠀.GHX (Grasshopper 1.0.7)
# plug-ins: Heteroptera, Pufferfish, BullAnt

digit_scroller = DigitScroller(Scroller_Digits=12, Scroller_Prefix=" ", Scroller_Radix=11, Scroller_Value=16)
digit_scroller_2 = DigitScroller(Scroller_Digits=12, Scroller_Prefix=" ", Scroller_Radix=1, Scroller_Value=0.718282)
range = Range(Domain=Domain(1e-07, 1), Steps=digit_scroller)  # -> reverse(Range)

digit_scroller_3 = DigitScroller(Scroller_Digits=12, Scroller_Prefix=" ", Scroller_Radix=1, Scroller_Value=0.538)
expression = Expression(X=range, O=Slider(2.1, range=0..4), Expression="1-(1-ABS(X-0)^O)^(((1)/(O)))")
expression_2 = Expression(X=range, O=Slider(0.8, range=0..4), Expression="(1-ABS(X-1)^O)^(((1)/(O)))")

quick_graph = QuickGraph(expression_2, SortOrder=0)
plane_surface = PlaneSurface(Plane=PlaneXY(0, 0, 1), XSize=Domain(-1, 1), YSize=Domain(-1, 1))
center = Center(Geometric=plane_surface, forall=True, referenceAll=0)  # -> Center, Dimension
graph_mapper = GraphMapper(range, x0=0, x1=1, y0=0, y1=1, Cx=0.7377286553, Cy=0.2671439648, container_name="Conic")
rectangle = Rectangle(plane_surface)
digit_scroller_4 = DigitScroller(Scroller_Digits=12, Scroller_Prefix="Digit Scroller", Scroller_Radix=9, Scroller_Value=64)
range_2 = Range(Domain=Domain(1e-28, 1), Steps=digit_scroller)
expression_3 = Expression(X=range_2, O=Slider(1.6, range=0..4), Expression="(1-ABS(X-1)^O)^(((1)/(O)))")

expression_4 = Expression(X=range_2, O=Slider(2.4, range=0..4), Expression="1-(1-ABS(X-0)^O)^(((1)/(O)))")
expression_5 = Expression(X=range_2, O=Slider(0.1, range=0..4), Expression="(1-ABS(X-1)^O)^(((1)/(O)))")

arc = Arc(Plane=PlaneXY(1, 0.5, 0), Radius=0.5, Angle=Domain(1.570796327, 3.141592654))  # -> Arc, Length
arc_2 = Arc(Plane=Plane(origin=(0, 0.5, 0), x=(-1, 0, 0), y=(0, -1, 0)), Radius=0.5, Angle=Domain(1.570796327, 3.141592654))  # -> Arc, Length

digit_scroller_5 = DigitScroller(Scroller_Digits=12, Scroller_Prefix=" ", Scroller_Radix=1, Scroller_Value=0.538)
expression_6 = Expression(X=range, O=Slider(2, range=0..4), Expression="(1-ABS(X-1)^O)^(((1)/(O)))")

digit_scroller_6 = DigitScroller(Scroller_Digits=12, Scroller_Prefix=" ", Scroller_Radix=1, Scroller_Value=0.718282)

digit_scroller_7 = DigitScroller(Scroller_Digits=12, Scroller_Prefix=" ", Scroller_Radix=1, Scroller_Value=0.538)
expression_7 = Expression(X=range, O=Slider(2.1, range=0..4), Expression="1-(1-ABS(X-0)^O)^(((1)/(O)))")
expression_8 = Expression(X=range, O=Slider(0.75, range=0..4), Expression="(1-ABS(X-1)^O)^(((1)/(O)))")

expression_9 = Expression(X=range_2, Expression="-cos(((x*PI)))/2+.5")
join_curves = JoinCurves(Curves=[arc_2.Arc, arc.Arc], Preserve=False)
expression_10 = Expression(X=range, Expression="-cos(((x*PI)))/2+.5")
graph_mapper_2 = GraphMapper(range_2, x0=0, x1=1, y0=0, y1=1, container_name="Sigmoid-Logits", e=0.04574238136, t0=-100, t1=100)
expression_11 = Expression(X=range, Expression="asin(((x-.5)*2))/PI+.5")
line_sdl = LineSDL(Start=Point(0, 0, 0), Direction=Vector(1, 1, 0), Length=1.414213562)
mirror = Mirror(Geometry=join_curves, Plane=Plane(origin=(0, 0, 0), x=(0, 0, 1), y=(0.7071067812, 0.7071067812, 0)))  # -> Geometry, Transform
construct_point = ConstructPoint(XCoordinate=range, YCoordinate=expression_8, ZCoordinate=0)
quad_sphere = QuadSphere(Base=PlaneXY(0, 0, 0), Radius=1)
deconstruct_brep = DeconstructBrep(Brep=quad_sphere)  # -> Faces, Edges, Vertices
quick_graph_2 = QuickGraph(expression_8, SortOrder=0)
list_item = ListItem(List=deconstruct_brep.Faces, Index=0, Wrap=False)
construct_point_2 = ConstructPoint(XCoordinate=range, YCoordinate=expression_10, ZCoordinate=0)
digit_scroller_8 = DigitScroller(Scroller_Digits=12, Scroller_Prefix="Digit Scroller", Scroller_Radix=9, Scroller_Value=16)
point = Point(Point(0, 0, 0))
interpolate = Interpolate(Vertices=construct_point_2, Degree=3, Periodic=False, KnotStyle=1)  # -> Curve, Length, Domain
number_slider = Slider(0.725273, range=0..2)
scale = Scale(Geometry=construct_point, Center=Point(0, 0, 0), Factor=0.5)  # -> reverse(Geometry), Transform
mirror_2 = Mirror(Geometry=scale.Geometry, Plane=Plane(origin=(0, 0, 0), x=(0, 0, 1), y=(0.7071067812, 0.7071067812, 0)))  # -> Geometry, Transform
move = Move(Geometry=mirror_2.Geometry, Motion=Vector(0.5, 0.5, 0))  # -> Geometry, Transform
scale_2 = Scale(Geometry=scale.Geometry, Center=Point(0, 0, 0), Factor=number_slider)  # -> Geometry, Transform
interpolate_2 = Interpolate(Vertices=construct_point, Degree=3, Periodic=False, KnotStyle=1)  # -> Curve, Length, Domain
scale_3 = Scale(Geometry=interpolate_2.Curve, Center=Point(0, 0, 0), Factor=expr("2^X", digit_scroller_8))  # -> Geometry, Transform
end_points = EndPoints(Curve=scale_3.Geometry)  # -> Start, End
rectangle_2pt = Rectangle2Pt(Plane=PlaneXY(0, 0, 0), PointA=end_points.Start, PointB=end_points.End, Radius=0)  # -> Rectangle, Length
scale_4 = Scale(Geometry=move.Geometry, Center=Point(0, 0, 0), Factor=expr("2-X", number_slider))  # -> Geometry, Transform
expression_12 = Expression(X=range_2, Expression="asin(((x-.5)*2))/PI+.5")
list_item_2 = ListItem(List=reverse(scale_2.Geometry), Index=0, Wrap=False)
list_item_3 = ListItem(List=scale_4.Geometry, Index=0, Wrap=False)
graph_mapper_3 = GraphMapper(range_2, x0=0, x1=1, y0=0, y1=1, Cx=1, Cy=0, container_name="Conic")
dot_display = DotDisplay(Point=list_item_2, Colour=RGB(0, 0, 0), Size=0.0625)  # disabled
graphmapper = GraphMapper(Curve=scale_3.Geometry, Boundary=rectangle_2pt.Rectangle, Numbers=range, bobo=False)
scale_5 = Scale(Geometry=rectangle, Center=center.Center, Factor=graphmapper)  # -> graft(Geometry), Transform
scale_6 = Scale(Geometry=scale_5.Geometry, Center=Point(0, 0, 0), Factor=expr("2^X", digit_scroller_4))  # -> Geometry, Transform
divide_curve = DivideCurve(Curve=scale_6.Geometry, Count=expr("X*4", digit_scroller), Kinks=False)  # -> Points, Tangents, Parameters
scale_7 = Scale(Geometry=divide_curve.Points, Center=Point(0, 0, 0), Factor=expr("1/2^X", digit_scroller_4))  # -> Geometry, Transform
flip_matrix = FlipMatrix(Data=scale_7.Geometry)
panel = Panel(flip_matrix)
interpolate_3 = Interpolate(Vertices=flip_matrix, Degree=3, Periodic=False, KnotStyle=1)  # -> Curve, Length, Domain
extrude_point = ExtrudePoint(Base=interpolate_3.Curve, Point=point)  # disabled
vector_2pt = Vector2Pt(PointA=list_item_3, PointB=list_item_2, Unitize=False)  # -> Vector, Length
move_2 = Move(Geometry=scale_4.Geometry, Motion=vector_2pt.Vector)  # -> Geometry, Transform
pull_curve = PullCurve(Curve=interpolate_3.Curve, Surface=list_item)

graphmapper_2 = GraphMapper(Curve=scale_3.Geometry, Boundary=rectangle_2pt.Rectangle, Numbers=range_2, bobo=True)
prude_curve = PrudeCurve(Curve=scale_5.Geometry, Length=graft(graph_mapper_3), BlendType=1, Bulge=0.5)  # -> Prude, ResultBoolean
prude_curve_2 = PrudeCurve(Curve=scale_5.Geometry, Length=graft(graph_mapper_3), BlendType=0, Bulge=Slider(0.4, range=0..1))  # -> Prude, ResultBoolean

pull_curve_2 = PullCurve(Curve=prude_curve_2.Prude, Surface=list_item)
curve = Curve([interpolate_3.Curve, prude_curve_2.Prude])
number = Number(digit_scroller)
merge = Merge(Data1=scale_2.Geometry, Data2=move_2.Geometry)
brep_brep = BrepBrep(BrepA=extrude_point, BrepB=list_item)  # -> Curves, Points
curve_2 = Curve(pull_curve)
curve_3 = Curve(pull_curve_2)
curve_graph_mapper = CurveGraphMapper(Curves=scale_3.Geometry, Rectangle=rectangle_2pt.Rectangle, Values=range, Flip=False, Snap=True, TextSize=1)  # -> Mapped, GraphCurves, GraphPoints, ValueLines, ValuePoints, MappedLines, MappedPoints, Boundary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; disabled
curve_4 = Curve([pull_curve, pull_curve_2])
digit_scroller_9 = DigitScroller(Scroller_Digits=12, Scroller_Prefix="Digit Scroller", Scroller_Radix=11, Scroller_Value=83)
curve_curve = CurveCurve(CurveA=flatten(curve_2), CurveB=curve_3)  # -> Points, ParamsA, ParamsB; disabled
curvature_graph = CurvatureGraph(Curve=pull_curve_2, Density=1, Scale=digit_scroller_9)  # disabled
cull_duplicates = CullDuplicates(Points=merge, Tolerance=0.00390625, CullMode=1)  # -> Points, Indices, Valence
curve_5 = Curve(curve_4)
divide_curves_on_intersects = DivideCurvesOnIntersects(Curves=flatten(curve_5), Tolerance=0)
ggcurvessplitintersect = GgCurvesSplitIntersect(Curves=flatten(curve_5), Tol=0, SplitPoly=False)  # disabled
digit_scroller_10 = DigitScroller(Scroller_Digits=12, Scroller_Prefix="Digit Scroller", Scroller_Radix=11, Scroller_Value=13)
merge_2 = Merge(Data1=curve_2, Data2=curve_3)  # disabled
mirror_3 = Mirror(Geometry=merge_2, Plane=PlaneXY(0, 0, 0))  # -> Geometry, Transform
ggnetworkpolygons = GgNetworkPolygons(Curves=divide_curves_on_intersects, PerimOrVoid=4)
merge_3 = Merge(Data1=merge_2, Data2=mirror_3.Geometry)
discontinuity = Discontinuity(Curve=ggnetworkpolygons, Level=1)  # -> Points, Parameters
polar_array = PolarArray(
    Geometry=graft(merge_3),
    Plane=[Plane(origin=(0, 0, 0), x=(0, 0, 1), y=(1, 0, 0)), PlaneYZ(0, 0, 0)],
    Count=2,
    Angle=3.141592654)  # -> Geometry, Transform
list_item_4 = ListItem(List=discontinuity.Points, Index=0, Wrap=False)  # -> Item, Item1, Item2, Item3, Item4
_4point_surface = _4PointSurface(CornerA=list_item_4.Item, CornerB=list_item_4.Item1, CornerC=list_item_4.Item2, CornerD=list_item_4.Item3)  # disabled
geometry = Geometry(polar_array.Geometry)
center_box = CenterBox(Base=PlaneXY(1, 0, 0), X=1, Y=1, Z=1)  # disabled
mesh_box = MeshBox(Base=center_box, XCount=1, YCount=1, ZCount=1)  # disabled
panel_2 = Panel(list_item_4.Item)
brep_join = BrepJoin(Breps=flatten(_4point_surface))  # -> Breps, Closed; disabled
merge_4 = Merge(Data1=list_item_4.Item, Data2=list_item_4.Item1, Data3=list_item_4.Item2, Data4=list_item_4.Item3)
construct_mesh = ConstructMesh(Vertices=merge_4, Faces={A=0, B=1, C=2, D=3})  # -> flatten(Mesh)
mesh_join = MeshJoin(Meshes=flatten(construct_mesh))
plane_surface_2 = PlaneSurface(Plane=PlaneYZ(0, 0, 0), XSize=Domain(-10, 10), YSize=Domain(-10, 10))
brep_plane = BrepPlane(Brep=brep_join.Breps, Plane=plane_surface_2)  # -> Curves, Points; disabled
mesh_plane = MeshPlane(Boundary=plane_surface_2, WidthCount=10, HeightCount=10)  # -> Mesh, Area
mirror_cut_mesh = MirrorCutMesh(
    Mesh=mesh_join,
    MirrorPlane=plane_surface_2,
    Reach=0,
    Offset=0,
    Flip=False,
    Join=True,
    Keep=False,
    ConnectionType=1,
    Bulge=0,
    Divisions=1,
    WeldVertices=0.0009765625)  # -> MirrorCut, SplitIndex, ReachPlane, OffsetPlane, Intersected; disabled
mesh_join_2 = MeshJoin(Meshes=flatten(mirror_cut_mesh.MirrorCut))  # disabled
mirror_cut_mesh_2 = MirrorCutMesh(
    Mesh=mirror_cut_mesh.MirrorCut,
    MirrorPlane=Plane(origin=(0, 0, 0), x=(0, 0, 1), y=(1, 0, 0)),
    Reach=0,
    Offset=0,
    Flip=False,
    Join=True,
    Keep=False,
    ConnectionType=1,
    Bulge=0,
    Divisions=1,
    WeldVertices=0.0009765625)  # -> MirrorCut, SplitIndex, ReachPlane, OffsetPlane, Intersected; disabled
