# Grasshopper definition XHG.⠀ⵙ⠀ᗝ⠀ⵙ⠀ꖴ⠀ⵙ⠀Ⓞ⠀ⵙ⠀ᙏ⠀ⵙ⠀ᕤᕦ⠀ⵙ⠀ꖴ⠀ⵙ⠀ᔓᔕ⠀ⵙ⠀◯⠀ⵙ⠀ИN⠀ⵙ⠀Ⓞ⠀ⵙ⠀ꖴ⠀ⵙ⠀✤⠀ⵙ⠀ꖴ⠀ⵙ⠀ᔓᔕ⠀ⵙ⠀ИN⠀ⵙ⠀ᗩ⠀ⵙ⠀ᴥ⠀ⵙ⠀✤⠀ⵙ⠀◯⠀ⵙ⠀ᗱᗴ⠀ⵙ⠀ᕤᕦ⠀ⵙ⠀ᗝ⠀ⵙ⠀ᗱᗴ⠀ⵙ⠀◯⠀ⵙ⠀ᙁ⠀ⵙ⠀ᑎ⠀ⵙ⠀ꗳ⠀ⵙ⠀◯⠀ⵙ⠀◯⠀ⵙ⠀ꗳ⠀ⵙ⠀ᑎ⠀ⵙ⠀ᙁ⠀ⵙ⠀◯⠀ⵙ⠀ᗱᗴ⠀ⵙ⠀ᗝ⠀ⵙ⠀ᕤᕦ⠀ⵙ⠀ᗱᗴ⠀ⵙ⠀◯⠀ⵙ⠀✤⠀ⵙ⠀ᴥ⠀ⵙ⠀ᗩ⠀ⵙ⠀ИN⠀ⵙ⠀ᔓᔕ⠀ⵙ⠀ꖴ⠀ⵙ⠀✤⠀ⵙ⠀ꖴ⠀ⵙ⠀Ⓞ⠀ⵙ⠀ИN⠀ⵙ⠀◯⠀ⵙ⠀ᔓᔕ⠀ⵙ⠀ꖴ⠀ⵙ⠀ᕤᕦ⠀ⵙ⠀ᙏ⠀ⵙ⠀Ⓞ⠀ⵙ⠀ꖴ⠀ⵙ⠀ᗝ⠀ⵙ⠀.GHX (Grasshopper 1.0.7)

line_sdl = LineSDL(Start=Point(0, 0, 0), Direction=Vector(1, 0, 0), Length=1)

create_material = CreateMaterial(Diffuse=RGB(235, 235, 235), Specular=RGB(0, 255, 255), Emission=RGB(0, 0, 0), Transparency=0.5, Shine=100)
create_material_2 = CreateMaterial(Diffuse=RGB(224, 224, 224), Specular=RGB(0, 255, 255), Emission=RGB(0, 0, 0), Transparency=0.5, Shine=100)
create_material_3 = CreateMaterial(Diffuse=RGB(242, 242, 242), Specular=RGB(0, 255, 255), Emission=RGB(0, 0, 0), Transparency=0.5, Shine=100)

digit_scroller = DigitScroller(Scroller_Digits=12, Scroller_Prefix=" ", Scroller_Radix=11, Scroller_Value=90)
create_material_4 = CreateMaterial(Diffuse=RGB(199, 199, 199), Specular=RGB(0, 255, 255), Emission=RGB(0, 0, 0), Transparency=0.5, Shine=100)
create_material_5 = CreateMaterial(Diffuse=RGB(232, 232, 232), Specular=RGB(0, 255, 255), Emission=RGB(0, 0, 0), Transparency=0.5, Shine=100)
curve = Curve()
custom_preview = CustomPreview(Geometry=curve, Material=create_material_4)
curvature_graph = CurvatureGraph(Curve=curve, Density=1, Scale=digit_scroller)
create_material_6 = CreateMaterial(Diffuse=RGB(222, 222, 222), Specular=RGB(0, 255, 255), Emission=RGB(0, 0, 0), Transparency=0.5, Shine=100)

panel = Panel("""256    0.0013733120705119695
4096    0.0000053644183496292""")

digit_scroller_2 = DigitScroller(Scroller_Digits=12, Scroller_Prefix="Digit Scroller", Scroller_Radix=1, Scroller_Value=3.3527e-07)
radians = Radians(Degrees="0.0000053644183496292")

number = Number(Slider(4096, range=0..65536))

series = Series(Start=0, Step=radians, Count=number)
one_over_x = OneOverX(Value=number)
duplicate_data = DuplicateData(Data=one_over_x, Number=number, Order=True)
turtle = DotNETVBScriptLEGACY(Forward=duplicate_data, Left=series)  # -> Output, Points; inputs Forward: list, Left: list
# ---------- turtle: VB ----------
    Dim i As Integer
    Dim dir As New On3dVector(1, 0, 0)    
    Dim pos As New On3dVector(0, 0, 0) 
    Dim axis As New On3dVector(0, 0, 1)
    Dim pnts As New List(Of On3dVector)

    pnts.Add(pos)
    
    For i = 0 To Forward.Count() - 1
      Dim P As New On3dVector
      dir.Rotate(Left(i), axis)      
      P = dir * Forward(i) + pnts(i)
      pnts.Add(P)
    Next
    
    Points = pnts
# ---------- end turtle ----------
point = Point(turtle.Points)

interpolate_t = InterpolateT(Vertices=point, TangentStart=Vector(0.0625, 0, 0), TangentEnd=Vector(0, 0, 0), KnotStyle=2)  # -> Curve, Length, Domain
evaluate_length = EvaluateLength(Curve=interpolate_t.Curve, Length=1, Normalized=True)  # -> Point, Tangent, Parameter
line_sdl_2 = LineSDL(Start=evaluate_length.Point, Direction=evaluate_length.Tangent, Length=1)
mirror = Mirror(Geometry=interpolate_t.Curve, Plane=line_sdl_2)  # -> Geometry, Transform
join_curves = JoinCurves(Curves=[interpolate_t.Curve, mirror.Geometry], Preserve=False)
evaluate_length_2 = EvaluateLength(Curve=join_curves, Length=1, Normalized=True)  # -> Point, Tangent, Parameter
rotate = Rotate(Geometry=join_curves, Angle=3.141592654, Plane=evaluate_length_2.Point)  # -> Geometry, Transform
join_curves_2 = JoinCurves(Curves=[join_curves, rotate.Geometry], Preserve=False)
curve_2 = Curve(join_curves_2)

expression = Expression(O=turtle.Points, Expression="FORMAT(\"{0:R}\",O)")
panel_2 = Panel(expression)
evaluate_length_3 = EvaluateLength(Curve=join_curves_2, Length=1, Normalized=True)  # -> Point, Tangent, Parameter
deconstruct = Deconstruct(Point=evaluate_length_3.Point)  # -> XComponent, YComponent, ZComponent
expression_2 = Expression(O=deconstruct.YComponent, Expression="FORMAT(\"{0:R}\",O)")
expression_3 = Expression(O=deconstruct.XComponent, Expression="FORMAT(\"{0:R}\",O)")
expression_4 = Expression(O=deconstruct.ZComponent, Expression="FORMAT(\"{0:R}\",O)")
panel_3 = Panel(expression_2)
panel_4 = Panel(expression_3)
panel_5 = Panel(expression_4)
addition = Addition(A=panel_3, B=panel_4)
expression_5 = Expression(O=addition, Expression="FORMAT(\"{0:R}\",O)")
panel_6 = Panel(expression_5)
division = Division(A=panel_6, B=2)
expression_6 = Expression(O=division, Expression="FORMAT(\"{0:R}\",O)")
panel_7 = Panel(expression_6)
scale = Scale(Geometry=curve_2, Center=Point(0, 0, 0), Factor=expr("1/X", panel_7))  # -> Geometry, Transform
evaluate_length_4 = EvaluateLength(Curve=scale.Geometry, Length=1, Normalized=True)  # -> Point, Tangent, Parameter
deconstruct_2 = Deconstruct(Point=evaluate_length_4.Point)  # -> XComponent, YComponent, ZComponent
expression_7 = Expression(O=deconstruct_2.YComponent, Expression="FORMAT(\"{0:R}\",O)")
expression_8 = Expression(O=deconstruct_2.XComponent, Expression="FORMAT(\"{0:R}\",O)")
expression_9 = Expression(O=deconstruct_2.ZComponent, Expression="FORMAT(\"{0:R}\",O)")
panel_8 = Panel(expression_9)
panel_9 = Panel(expression_7)
panel_10 = Panel(expression_8)
division_2 = Division(A=panel_4, B=panel_3)
expression_10 = Expression(O=division_2, Expression="FORMAT(\"{0:R}\",O)")
panel_11 = Panel(expression_10)
curve_3 = Curve(scale.Geometry)

divide_curve = DivideCurve(Curve=curve_3, Count=expr("X*4", number), Kinks=False)  # -> Points, Tangents, Parameters
panel_13 = Panel(divide_curve.Points)
expression_11 = Expression(O=divide_curve.Points, Expression="FORMAT(\"{0:R}\",O)")  # disabled

digit_scroller_3 = DigitScroller(Scroller_Digits=12, Scroller_Prefix="Digit Scroller", Scroller_Radix=11, Scroller_Value=65536)  # disabled
construct_point = ConstructPoint(XCoordinate=0.5, YCoordinate=0.5, ZCoordinate=0)  # -> flatten(Point); disabled
line_sdl_3 = LineSDL(Start=Point(0, 0, 0), Direction=Vector(1, 0, 0), Length=expr("X/2", 1))  # disabled
button = Button()  # disabled
number_2 = Number(expr("X*4", number))  # disabled
divide_curve_2 = DivideCurve(Curve=line_sdl_3, Count=expr("X/2", number_2), Kinks=False)  # -> Points, Tangents, Parameters; disabled
line_sdl_4 = LineSDL(Start=divide_curve_2.Points, Direction=Vector(0, 1, 0), Length=1)  # disabled
file_path = FilePath("C:\IICSA.O____48361_EDIWID_1_TNEMERCNI____TNEIDARG_PUKOOL_ROLOC_DIOMGIS_ERUTAWRUC_RAENIL_NOITISNART_EGDE_LUF_EKUN____O____NUKE_FUL_EDGE_TRANSITION_LINEAR_CURWATURE_SIGMOID_COLOR_LOOKUP_GRADIENT____INCREMENT_1_DIWIDE_16384____O.ASCII")  # disabled
number_3 = Number(digit_scroller_3)  # disabled
scale_2 = Scale(Geometry=line_sdl_4, Center=Point(0, 0, 0), Factor=number_3)  # -> Geometry, Transform; disabled
curve_4 = Curve(curve_3)  # disabled
scale_3 = Scale(Geometry=curve_4, Center=Point(0, 0, 0), Factor=number_3)  # -> Geometry, Transform; disabled
curve_curve = CurveCurve(CurveA=scale_3.Geometry, CurveB=scale_2.Geometry)  # -> flatten(Points), ParamsA, ParamsB; disabled
scale_4 = Scale(Geometry=curve_curve.Points, Center=Point(0, 0, 0), Factor=expr("1/X", number_3))  # -> Geometry, Transform; disabled
deconstruct_3 = Deconstruct(Point=scale_4.Geometry)  # -> expr("ABS(X)", graft(XComponent)), expr("ABS(X)", graft(YComponent)), expr("ABS(X)", graft(ZComponent)); disabled
construct_point_2 = ConstructPoint(XCoordinate=deconstruct_3.XComponent, YCoordinate=deconstruct_3.YComponent, ZCoordinate=deconstruct_3.ZComponent)  # disabled
list_length = ListLength(List=scale_4.Geometry)  # disabled
panel_14 = Panel(list_length)  # disabled
construct_domain = ConstructDomain(DomainStart=0, DomainEnd=expr("X-2", panel_14))  # disabled
range = Range(Domain=construct_domain, Steps=expr("X-2", panel_14))  # disabled
list_item = ListItem(List=flatten(construct_point_2), Index=range, Wrap=False)  # -> flatten(Item); disabled
rotate_2 = Rotate(Geometry=list_item, Angle=3.141592654, Plane=construct_point)  # -> reverse(flatten(Geometry)), Transform; disabled
merge = Merge(Data1=list_item, Data2=construct_point, Data3=rotate_2.Geometry)  # disabled
deconstruct_4 = Deconstruct(Point=merge)  # -> graft(XComponent), graft(YComponent), ZComponent; disabled
expression_12 = Expression(O=deconstruct_4.XComponent, Expression="FORMAT(\"{0:0.00000000000000}\",O)")  # disabled
expression_13 = Expression(O=deconstruct_4.XComponent, Expression="FORMAT(\"{0:R}\",O)")  # disabled
data = Data(expression_13)  # disabled
panel_15 = Panel(data)  # disabled
expression_14 = Expression(O=deconstruct_4.YComponent, Expression="FORMAT(\"{0:0.00000000000000}\",O)")  # disabled
expression_15 = Expression(O=deconstruct_4.YComponent, Expression="FORMAT(\"{0:R}\",O)")  # disabled
data_2 = Data(expression_15)  # disabled
panel_16 = Panel(data_2)  # disabled
txtwriter = VBScript(filePath=file_path, data=flatten(panel_16), activate=button)  # -> out, A; inputs data: list; disabled
# ---------- txtwriter: VB ----------
    If activate Then

      Dim i As Integer
      Dim aryText(4) As String

      aryText(0) = "Mary WriteLine"
      aryText(1) = "Had"
      aryText(2) = "Another"
      aryText(3) = "Little"
      aryText(4) = "One"

      ' the data is appended to the file. If file doesnt exist, a new file is created
      Dim objWriter As New System.IO.StreamWriter(filePath, append)

      For i = 0 To data.Count - 1
        objWriter.WriteLine(data(i))
      Next

      objWriter.Close()

    End If

    If clearFile Then
      Dim objWriter As New System.IO.StreamWriter(filePath, False)
      objWriter.Close()
    End If
# ---------- end txtwriter ----------

button_2 = Button()  # disabled
number_4 = Number(expr("X*4", number))  # disabled
file_path_2 = FilePath("C:\VSC.O____STNEMGES_48361____DIOMGIS_ERUTAWRUC_RAENIL_NOITISNART_EGDE_LUF____O____FUL_EDGE_TRANSITION_LINEAR_CURWATURE_SIGMOID____16384_SEGMENTS____O.CSV")  # disabled
curve_5 = Curve(curve_3)  # disabled
divide_curve_3 = DivideCurve(Curve=curve_5, Count=number_4, Kinks=False)  # -> Points, Tangents, Parameters; disabled
deconstruct_5 = Deconstruct(Point=divide_curve_3.Points)  # -> graft(XComponent), graft(YComponent), ZComponent; disabled
expression_16 = Expression(Y=deconstruct_5.YComponent, Expression="FORMAT(\"{0:R}\",ROUND(Y, 15))")  # -> simplify(Result); disabled
expression_17 = Expression(X=deconstruct_5.XComponent, Expression="FORMAT(\"{0:R}\",ROUND(X, 15))")  # -> simplify(Result); disabled
expression_18 = Expression(X=deconstruct_5.XComponent, Expression="FORMAT(\"{0:R}\",X)")  # -> simplify(Result); disabled
panel_17 = Panel(expression_18)  # disabled
expression_19 = Expression(Y=deconstruct_5.YComponent, Expression="FORMAT(\"{0:R}\",Y)")  # -> simplify(Result); disabled
list_length_2 = ListLength(List=divide_curve_3.Points)  # disabled
duplicate_data_2 = DuplicateData(Data=";", Number=list_length_2, Order=True)  # -> simplify(graft(Data)); disabled
panel_18 = Panel(duplicate_data_2)  # disabled
panel_19 = Panel(expression_19)  # disabled
concatenate = Concatenate(FragmentA=panel_17, FragmentB=panel_18, FragmentA_2=panel_19)  # -> flatten(Result); disabled
panel_20 = Panel(concatenate)  # disabled
txtwriter_2 = VBScript(filePath=file_path_2, data=flatten(panel_20), activate=button_2)  # -> out, A; inputs data: list; disabled; same code as txtwriter

number_slider = Slider(0, range=0..1)  # disabled
button_3 = Button()  # disabled
number_5 = Number(expr("X*4", number))  # disabled
file_path_3 = FilePath("C:\VSC.O____EPAHS_LANGIS____STNEMGES_48361____DIOMGIS_ERUTAWRUC_RAENIL_NOITISNART_EGDE_LUF____O____FUL_EDGE_TRANSITION_LINEAR_CURWATURE_SIGMOID____16384_SEGMENTS____SIGNAL_SHAPE____O.CSV")  # disabled
curve_6 = Curve(curve_3)  # disabled
evaluate_length_5 = EvaluateLength(Curve=curve_6, Length=flatten(1), Normalized=True)  # -> Point, Tangent, Parameter; disabled
yz_plane = YZPlane(Origin=evaluate_length_5.Point)  # disabled
mirror_2 = Mirror(Geometry=curve_6, Plane=yz_plane)  # -> Geometry, Transform; disabled
join_curves_3 = JoinCurves(Curves=[curve_6, mirror_2.Geometry], Preserve=False)  # disabled
linear_array = LinearArray(Geometry=join_curves_3, Direction=Vector(2, 0, 0), Count=2)  # -> Geometry, Transform; disabled
join_curves_4 = JoinCurves(Curves=linear_array.Geometry, Preserve=False)  # disabled
flip_curve = FlipCurve(Curve=join_curves_4)  # -> Curve, Flag; disabled
stream_filter = StreamFilter(Gate=number_slider, Stream0=join_curves_4, Stream1=flip_curve.Curve)  # disabled
curve_domain = CurveDomain(Curve=stream_filter)  # -> Curve, Domain; disabled
deconstruct_domain = DeconstructDomain(Domain=curve_domain.Domain)  # -> Start, End; disabled
construct_domain_2 = ConstructDomain(DomainStart=expr("X/8", deconstruct_domain.End), DomainEnd=expr("X*5/8", deconstruct_domain.End))  # disabled
sub_curve = SubCurve(BaseCurve=curve_domain.Curve, Domain=construct_domain_2)  # disabled
move = Move(Geometry=sub_curve, Motion=Vector(-0.5, -0.5, 0))  # -> Geometry, Transform; disabled
scale_5 = Scale(Geometry=move.Geometry, Center=Point(0, 0, 0), Factor=0.5)  # -> Geometry, Transform; disabled
divide_curve_4 = DivideCurve(Curve=scale_5.Geometry, Count=number_5, Kinks=False)  # -> Points, Tangents, Parameters; disabled
deconstruct_6 = Deconstruct(Point=divide_curve_4.Points)  # -> simplify(graft(XComponent)), simplify(graft(YComponent)), ZComponent; disabled
expression_20 = Expression(X=deconstruct_6.XComponent, Expression="FORMAT(\"{0:R}\",X)")  # disabled
panel_21 = Panel(expression_20)  # disabled
expression_21 = Expression(Y=deconstruct_6.YComponent, Expression="FORMAT(\"{0:R}\",Y)")  # disabled
list_length_3 = ListLength(List=divide_curve_4.Points)  # disabled
duplicate_data_3 = DuplicateData(Data=";", Number=list_length_3, Order=True)  # -> simplify(graft(Data)); disabled
panel_22 = Panel(duplicate_data_3)  # disabled
panel_23 = Panel(expression_21)  # disabled
concatenate_2 = Concatenate(FragmentA=panel_21, FragmentB=panel_22, FragmentA_2=panel_23)  # -> flatten(Result); disabled
panel_24 = Panel(concatenate_2)  # disabled
txtwriter_3 = VBScript(filePath=file_path_3, data=flatten(panel_24), activate=button_3)  # -> out, A; inputs data: list; disabled; same code as txtwriter

number_6 = Number(number)
divide_curve_5 = DivideCurve(Curve=curve, Count=number_6, Kinks=False)  # -> Points, Tangents, Parameters
curvature = Curvature(Curve=curve, Parameter=divide_curve_5.Parameters)  # -> Point, Curvature, Curvature_2
deconstruct_arc = DeconstructArc(Arc=curvature.Curvature_2)  # -> BasePlane, Radius, Angle
line = Line(StartPoint=curvature.Point, EndPoint=deconstruct_arc.BasePlane)
one_over_x_2 = OneOverX(Value=deconstruct_arc.Radius)
panel_25 = Panel(one_over_x_2)
quick_graph = QuickGraph(one_over_x_2, SortOrder=0)

bounds = Bounds(Numbers=panel_25)
remap_numbers = RemapNumbers(Value=panel_25, Source=bounds, Target=Domain(0, 1))  # -> Mapped, Clipped
multiplication = Multiplication(A=remap_numbers.Mapped, B=Slider(0.533043, range=0..2))

line_sdl_5 = LineSDL(Start=curvature.Point, Direction=line, Length=expr("-ABS(X)", multiplication))
evaluate_length_6 = EvaluateLength(Curve=line_sdl_5, Length=1, Normalized=True)  # -> Point, Tangent, Parameter
interpolate = Interpolate(Vertices=evaluate_length_6.Point, Degree=3, Periodic=False, KnotStyle=2)  # -> Curve, Length, Domain
custom_preview_2 = CustomPreview(Geometry=line_sdl_5, Material=create_material_5)
custom_preview_3 = CustomPreview(Geometry=interpolate.Curve, Material=create_material_6)

nurbs_curve = NurbsCurve(Vertices=evaluate_length_6.Point, Degree=3, Periodic=False)  # -> Curve, Length, Domain

polyline = PolyLine(Vertices=curvature.Point, Closed=False)
explode = Explode(Curve=polyline, Recursive=True)  # -> Segments, Vertices
curve_7 = Curve(flatten(explode.Segments))
length = Length(Curve=curve_7)
sort_list = SortList(Keys=length, ValuesValuesA=curve_7)  # -> Keys, ValuesValuesA
panel_26 = Panel(sort_list.Keys)
list_item_2 = ListItem(List=sort_list.Keys, Index=0, Wrap=False)

panel_27 = Panel(one_over_x_2)
panel_28 = Panel(one_over_x_2)
divide_curve_6 = DivideCurve(Curve=line_sdl, Count=number_6, Kinks=False)  # -> Points, Tangents, Parameters
line_sdl_6 = LineSDL(Start=divide_curve_6.Points, Direction=Vector(0, 1, 0), Length=panel_27)

derivatives = Derivatives(Curve=curve, Parameter=divide_curve_5.Parameters)  # -> Point, FirstDerivative, SecondDerivative, ThirdDerivative, FourthDerivative, FifthDerivative, SixthDerivative
relative_differences = RelativeDifferences(Values=one_over_x_2)
panel_29 = Panel(relative_differences)
quick_graph_2 = QuickGraph(relative_differences, SortOrder=0)
curve_8 = Curve(interpolate.Curve)
number_7 = Number(number_6)
divide_curve_7 = DivideCurve(Curve=curve_8, Count=number_7, Kinks=False)  # -> Points, Tangents, Parameters
curvature_2 = Curvature(Curve=curve_8, Parameter=divide_curve_7.Parameters)  # -> Point, Curvature, Curvature_2
deconstruct_arc_2 = DeconstructArc(Arc=curvature_2.Curvature_2)  # -> BasePlane, Radius, Angle
one_over_x_3 = OneOverX(Value=deconstruct_arc_2.Radius)

bounds_2 = Bounds(Numbers=relative_differences)
remap_numbers_2 = RemapNumbers(Value=relative_differences, Source=bounds_2, Target=Domain(0, 1))  # -> Mapped, Clipped
multiplication_2 = Multiplication(A=remap_numbers_2.Mapped, B=Slider(0.162613, range=0..1))

line_sdl_7 = LineSDL(Start=evaluate_length_6.Point, Direction=line_sdl_5, Length=expr("ABS(X)", multiplication_2))
evaluate_length_7 = EvaluateLength(Curve=line_sdl_7, Length=1, Normalized=True)  # -> Point, Tangent, Parameter
line_sdl_8 = LineSDL(Start=evaluate_length_7.Point, Direction=derivatives.ThirdDerivative, Length=expr("-X", multiplication_2))
custom_preview_4 = CustomPreview(Geometry=line_sdl_8, Material=create_material)
interpolate_2 = Interpolate(Vertices=evaluate_length_7.Point, Degree=3, Periodic=False, KnotStyle=2)  # -> Curve, Length, Domain
custom_preview_5 = CustomPreview(Geometry=interpolate_2.Curve, Material=create_material_2)
custom_preview_6 = CustomPreview(Geometry=line_sdl_7, Material=create_material_3)

evaluate_length_8 = EvaluateLength(Curve=line_sdl_8, Length=1, Normalized=True)  # -> Point, Tangent, Parameter
interpolate_3 = Interpolate(Vertices=evaluate_length_8.Point, Degree=3, Periodic=False, KnotStyle=2)  # -> Curve, Length, Domain
nurbs_curve_2 = NurbsCurve(Vertices=evaluate_length_8.Point, Degree=11, Periodic=False)  # -> Curve, Length, Domain
nurbs_curve_3 = NurbsCurve(Vertices=evaluate_length_7.Point, Degree=11, Periodic=False)  # -> Curve, Length, Domain
merge_2 = Merge(Data1=evaluate_length_7.Point)
dot_display = DotDisplay(Point=merge_2, Colour=RGB(194, 194, 194), Size=expr("X/2", list_item_2))
